# Grasshopper definition native-ceiling.gh (Grasshopper 1.0.8)

# ---- group: Shared inputs (hidden wires)
radius = Slider(10, range=0..50)
count = Slider(10, range=1..24)
polygon = Polygon(Plane=PlaneXY(0, 0, 0), Radius=2, Segments=5, FilletRadius=0)  # -> Polygon, Length

# ----
# Complete failure to automatically configure anything.
script_file_name = Panel("ring-array-auto-configured.cs")
# 1. Add a fresh C# Script component.
# 2. Shift-right-click the component. Enable Script Input Parameter.
# 3. Add a panel. Wire it into the “script” input.
# 4. Set the panel value to the file path of ring-array-auto-configured.cs.
# 5. Right-click the “script” input. Enable Input Is Path and Synchronize.
# Automated file path method shown below. Works
# if .gh file is in same folder as .cs /
# .py scripts.
c_script = CSharpScript()  # -> GH_File_Parent_Folder, ParentFolderPath
# ---------- c_script: C# ----------
// Grasshopper Script Instance
#region Usings
using System;
using System.Linq;
using System.Collections;
using System.Collections.Generic;
using System.Drawing;

using Rhino;
using Rhino.Geometry;

using Grasshopper;
using Grasshopper.Kernel;
using Grasshopper.Kernel.Data;
using Grasshopper.Kernel.Types;
#endregion

public class Script_Instance : GH_ScriptInstance
{
    #region Notes
    /* 
      Members:
        RhinoDoc RhinoDocument
        GH_Document GrasshopperDocument
        IGH_Component Component
        int Iteration

      Methods (Virtual & overridable):
        Print(string text)
        Print(string format, params object[] args)
        Reflect(object obj)
        Reflect(object obj, string method_name)
    */
    #endregion

    private void RunScript(ref object ParentFolderPath)
    {
        // Write your logic here
        ParentFolderPath = System.IO.Path.GetDirectoryName(GrasshopperDocument.FilePath);
    }
}
# ---------- end c_script ----------
concatenate = Concatenate(FragmentA=c_script.ParentFolderPath, FragmentB=script_file_name, JoinSeparator="/")
# Auto-configuration (extended functionality)
# 1. Add a fresh C# Script component.
# 2. Copy the source text from ring-array-auto-configured.cs
# 3. Paste text into the component via the Script Editor.
# Input and output parameters are established,
# including type hints and tooltips. Component
# name is set along with its description
# and icon.
# Script linked to source file
ringarr = RingArray(Geometry=polygon.Polygon, Radius=radius, Count=count)  # -> out, Points, Arrayed; inputs Geometry: GeometryBase, Radius: Double, Count: Int32
# ---------- ringarr: C# ----------
// Ring Array — copies one piece of geometry to a ring of points, rotating each
// copy outward. Wire a Polygon into Geometry for a rosette.
//
// Configures itself at solve time: param names, type hints, access, tooltips,
// component name, description and a drawn icon. Nothing to set up by hand,
// including the half no UI can reach.

using System;
using System.Collections.Generic;
using System.Drawing;
using System.Linq;
using System.Reflection;
using Grasshopper.Kernel;
using Rhino.Geometry;

public class Script_Instance : GH_ScriptInstance
{
  const string NAME  = "Ring Array";
  const string NICK  = "RingArr";
  const string BLURB = "Copies one piece of geometry to a ring of points.";

  // name, type hint, access, tooltip
  static readonly string[,] Inputs = {
    { "Geometry", "GeometryBase", "item", "Geometry to copy. Wire a Polygon component here." },
    { "Radius",   "double",       "item", "Radius of the ring, in model units." },
    { "Count",    "int",          "item", "How many copies to place around the ring." },
  };
  // name, type hint, tooltip. An output hint is durable state on the param but
  // changes nothing downstream: the body still sees `out object`, and the emitted
  // data is identical unhinted. Set for parity with what a C# paste builds from
  // `out List<Point3d>`. NEVER do this on Python — there it is an active converter
  // that collapses a list result.
  static readonly string[,] Outputs = {
    { "Points",  "Point3d",      "The ring of points, one per copy." },
    { "Arrayed", "GeometryBase", "The input geometry copied and rotated to each point." },
  };

  // Fallback fields — see the note above. Shadowed by the real arguments from
  // pass 2 onward, which is why the compiler calls them unused.
  GeometryBase Geometry;
  double Radius;
  int Count;
  object Points, Arrayed;

  private void RunScript(
		GeometryBase Geometry,
		double Radius,
		int Count,
		ref object Points,
		ref object Arrayed)
  {
    SetIdentity();
    SetParamText();

    if (!ShapeIsRight()) { BuildParams(); Points = null; Arrayed = null; return; }

    var pts = new List<Point3d>();
    var copies = new List<GeometryBase>();
    for (int i = 0; i < Count; i++)
    {
      double t = 2.0 * Math.PI * i / Math.Max(Count, 1);
      var pt = new Point3d(Radius * Math.Cos(t), Radius * Math.Sin(t), 0.0);
      pts.Add(pt);

      if (Geometry == null) continue;
      var frame = new Plane(pt, Vector3d.ZAxis);
      frame.Rotate(t, Vector3d.ZAxis, pt);
      var copy = Geometry.Duplicate();
      copy.Transform(Transform.PlaneToPlane(Plane.WorldXY, frame));
      copies.Add(copy);
    }
    Points = pts;
    Arrayed = copies;
  }

  // --- component identity ------------------------------------------------------
  // Two description slots and they are not interchangeable: Description is what
  // the tooltip shows right now and is regenerated on load; Tooltip is the
  // durable slot, archived into the .gh and restored over Description on open.
  void SetIdentity()
  {
    Component.Name = NAME;
    Component.NickName = NICK;
    SetString(Component, "Description", BLURB);
    SetString(Component, "Tooltip", BLURB);

    // The canvas icon slot is a plain Bitmap, drawn at its native pixel size.
    // SetIconOverride is declared on the concrete GH_DocumentObject, not on
    // IGH_Component, so the cast is required.
    var bmp = new Bitmap(24, 24);
    using (var g = Graphics.FromImage(bmp))
    {
      g.SmoothingMode = System.Drawing.Drawing2D.SmoothingMode.AntiAlias;
      g.Clear(Color.Transparent);
      using (var pen = new Pen(Color.FromArgb(220, 40, 60, 90), 2f))
        g.DrawEllipse(pen, 4, 4, 16, 16);
      for (int k = 0; k < 6; k++)
      {
        double a = 2.0 * Math.PI * k / 6;
        g.FillEllipse(Brushes.OrangeRed, (float)(11 + 8 * Math.Cos(a)), (float)(11 + 8 * Math.Sin(a)), 3, 3);
      }
    }
    ((GH_DocumentObject)Component).SetIconOverride(bmp);
    Component.IconDisplayMode = GH_IconDisplayMode.icon;
  }

  // --- per-param metadata ------------------------------------------------------
  // PrettyName is Name; ToolTip is the durable Description slot (writing ToolTip
  // writes Description too, and survives both a reopen and the next source push).
  void SetParamText()
  {
    for (int i = 0; i < Inputs.GetLength(0); i++)
    {
      var p = Component.Params.Input.FirstOrDefault(q => q.NickName == Inputs[i, 0]);
      if (p == null) continue;
      SetString(p, "PrettyName", Inputs[i, 0]);
      SetString(p, "ToolTip", Inputs[i, 3]);
      SelectTypeHint(p, Inputs[i, 1]);
      p.Access = Inputs[i, 2] == "list" ? GH_ParamAccess.list
               : Inputs[i, 2] == "tree" ? GH_ParamAccess.tree
               : GH_ParamAccess.item;
    }
    for (int i = 0; i < Outputs.GetLength(0); i++)
    {
      var p = Component.Params.Output.FirstOrDefault(q => q.NickName == Outputs[i, 0]);
      if (p == null) continue;
      SetString(p, "PrettyName", Outputs[i, 0]);
      SetString(p, "ToolTip", Outputs[i, 2]);
      SelectTypeHint(p, Outputs[i, 1]);
    }
  }

  // --- param-list surgery ------------------------------------------------------
  // A script component implements IGH_VariableParameterComponent — that is what
  // the zoom-in + / - widgets drive — so it can build its own params. Do it OUTSIDE
  // the solution, or GH 8's "object expired during a solution" guard locks the
  // canvas.
  bool ShapeIsRight()
  {
    var wantIn  = Enumerable.Range(0, Inputs.GetLength(0)).Select(i => Inputs[i, 0]);
    var wantOut = Enumerable.Range(0, Outputs.GetLength(0)).Select(i => Outputs[i, 0]);
    var haveOut = Component.Params.Output.Where(p => p.NickName != "out").Select(p => p.NickName);
    return Component.Params.Input.Select(p => p.NickName).SequenceEqual(wantIn)
        && haveOut.SequenceEqual(wantOut);
  }

  void BuildParams()
  {
    var comp = Component;
    var vc = comp as IGH_VariableParameterComponent;
    GrasshopperDocument.ScheduleSolution(5, doc =>
    {
      Fit(comp, vc, GH_ParameterSide.Input, comp.Params.Input, Inputs, 0);
      // The built-in "out" print stream sits at Output[0] when shown; leave it
      // alone and fit only what follows it.
      int keep = comp.Params.Output.Count(p => p.NickName == "out");
      Fit(comp, vc, GH_ParameterSide.Output, comp.Params.Output, Outputs, keep);
      // Hints MUST be selected here, not merely on the next solve: Grasshopper
      // rewrites RunScript's argument list from the params the moment they change,
      // and an unhinted param becomes a plain `object` argument. The body would
      // then fail to compile on `i < Count` and never get the chance to set them.
      SetParamText();
      comp.Params.OnParametersChanged();
      comp.ExpireSolution(false);
    });
  }

  static void Fit(IGH_Component comp, IGH_VariableParameterComponent vc,
                  GH_ParameterSide side, List<IGH_Param> ps, string[,] spec, int offset)
  {
    int want = spec.GetLength(0) + offset;
    while (ps.Count > want) { var p = ps[ps.Count - 1]; vc.DestroyParameter(side, ps.Count - 1); comp.Params.UnregisterParameter(p); }
    while (ps.Count < want)
    {
      var p = vc.CreateParameter(side, ps.Count);
      if (side == GH_ParameterSide.Input) comp.Params.RegisterInputParam(p);
      else comp.Params.RegisterOutputParam(p);
    }
    for (int i = 0; i < spec.GetLength(0); i++)
      SetVariableName(ps[i + offset], spec[i, 0]);
  }

  // --- reflection helpers ------------------------------------------------------
  // ScriptVariableParam and BaseScriptComponent live in RhinoCodePluginGH, which
  // the script sandbox does not reference, so every slot above is reached by
  // name. DeclaredOnly plus an explicit BaseType walk finds slots declared
  // non-publicly on a base and cannot throw on a shadowed name.

  // SetVariableName, not the VariableName property: the method is what the
  // right-click rename box calls, and it re-syncs the RunScript signature at
  // once. Writing the property leaves a renamed OUTPUT unbound until the source
  // is pushed again — silently, with no error.
  static void SetVariableName(IGH_Param p, string name)
  {
    var m = p.GetType().GetMethod("SetVariableName",
              BindingFlags.Public | BindingFlags.NonPublic | BindingFlags.Instance);
    if (m != null) m.Invoke(p, new object[] { name });
    else SetString(p, "VariableName", name);
  }

  static bool SetString(object target, string name, string value)
  {
    for (var t = target.GetType(); t != null; t = t.BaseType)
    {
      var p = t.GetProperty(name, BindingFlags.Public | BindingFlags.NonPublic
                                | BindingFlags.Instance | BindingFlags.DeclaredOnly);
      if (p == null || !p.CanWrite || p.PropertyType != typeof(string)) continue;
      p.SetValue(target, value);
      return true;
    }
    return false;
  }

  // A type hint is a Converter selected on the param, not the RunScript signature.
  // An unrecognised name silently leaves the current hint in place.
  static void SelectTypeHint(IGH_Param p, string typeName)
  {
    var hp = p.GetType().GetProperty("TypeHints");
    if (hp == null || string.IsNullOrEmpty(typeName)) return;
    var hints = hp.GetValue(p);
    var select = hints.GetType().GetMethod("Select", new[] { typeof(string) });
    if (select != null) select.Invoke(hints, new object[] { typeName });
  }
}
# ---------- end ringarr ----------
# Stock parameter configuration functionality
# 1. Add a fresh C# Script component.
# 2. Copy the source text from ring-array-stock.cs
# 3. Paste text into the component via the Script Editor.
# Input and output parameters are established,
# including type hints. No tooltips, component
# name, or icon are set.
c_script_2 = CSharpScript(Geometry=polygon.Polygon, Radius=radius, Count=count)  # -> out, Points, Arrayed; inputs Geometry: GeometryBase, Radius: Double, Count: Int32
# ---------- c_script_2: C# ----------
// Ring Array — copies one piece of geometry to a ring of points, rotating each
// copy outward. Wire a Polygon into Geometry for a rosette.
//
// The logic and nothing else: no param tooltips, no component name, no icon.
// Pasting it into the ScriptEditor builds the params and their type hints from the
// RunScript signature below, so it runs as it stands.

using System;
using System.Collections.Generic;
using Grasshopper.Kernel;
using Rhino.Geometry;

public class Script_Instance : GH_ScriptInstance
{
  private void RunScript(
		GeometryBase Geometry,
		double Radius,
		int Count,
		ref object Points,
		ref object Arrayed)
  {
    // Outputs arrive as ref object whatever you declare, so build the results in
    // locals of the real type and assign once at the end.
    var pts = new List<Point3d>();
    var copies = new List<GeometryBase>();

    for (int i = 0; i < Count; i++)
    {
      double t = 2.0 * Math.PI * i / Math.Max(Count, 1);
      var pt = new Point3d(Radius * Math.Cos(t), Radius * Math.Sin(t), 0.0);
      pts.Add(pt);

      if (Geometry == null) continue;
      var frame = new Plane(pt, Vector3d.ZAxis);
      frame.Rotate(t, Vector3d.ZAxis, pt);
      var copy = Geometry.Duplicate();
      copy.Transform(Transform.PlaneToPlane(Plane.WorldXY, frame));
      copies.Add(copy);
    }

    Points = pts;
    Arrayed = copies;
  }
}
# ---------- end c_script_2 ----------
c_script_3 = CSharpScript(script=concatenate)  # -> out, a
#   port script: Script to execute
# ---------- c_script_3: C# ----------
// Grasshopper Script Instance
#region Usings
using System;
using System.Linq;
using System.Collections;
using System.Collections.Generic;
using System.Drawing;

using Rhino;
using Rhino.Geometry;

using Grasshopper;
using Grasshopper.Kernel;
using Grasshopper.Kernel.Data;
using Grasshopper.Kernel.Types;
#endregion

public class Script_Instance : GH_ScriptInstance
{
    #region Notes
    /* 
      Members:
        RhinoDoc RhinoDocument
        GH_Document GrasshopperDocument
        IGH_Component Component
        int Iteration

      Methods (Virtual & overridable):
        Print(string text)
        Print(string format, params object[] args)
        Reflect(object obj)
        Reflect(object obj, string method_name)
    */
    #endregion

    private void RunScript(object x, object y, ref object a)
    {
        // Write your logic here
        a = null;
    }
}
# ---------- end c_script_3 ----------
script_file_name_2 = Panel("ring-array-auto-configured.py")
# 1. Add a fresh C# Script component.
# 2. Shift-right-click the component. Enable Script Input Parameter.
# 3. Add a panel. Wire it into the “script” input.
# 4. Set the panel value to the file path of ring-array-auto-configured.py.
# 5. Right-click the “script” input. Enable Input Is Path and Synchronize.
# Automated file path method shown below. Works
# if .gh file is in same folder as .cs /
# .py scripts.
c_script_4 = CSharpScript()  # -> GH_File_Parent_Folder, ParentFolderPath; same code as c_script
# 1. Add a fresh Python 3 Script component.
# 2. Copy the source text from ring-array-auto-configured.py
# 3. Paste text into the component via the Script Editor.
# Input and output parameters are established,
# including type hints and tooltips. Component
# name is set along with its description
# and icon.
ringarr_2 = RingArray(Geometry=polygon.Polygon, Radius=radius, Count=count)  # -> out, Points, Arrayed; inputs Geometry: GeometryBase, Radius: Double, Count: Int32
# ---------- ringarr_2: Python ----------
# Ring Array — copies one piece of geometry to a ring of points, rotating each
# copy outward. Wire a Polygon into Geometry for a rosette.
#
# Configures itself at solve time: param names, type hints, access, tooltips,
# component name, description and a drawn icon. Nothing to set up by hand,
# including the half no UI can reach.

import math

import System.Drawing as SD
import Grasshopper
import Rhino.Geometry as rg
from Grasshopper.Kernel import GH_ParamAccess, GH_ParameterSide, GH_IconDisplayMode

NAME = "Ring Array"
NICK = "RingArr"
BLURB = "Copies one piece of geometry to a ring of points."

# name, type hint, access, tooltip.  Hint names are the PYTHON spelling: "float"
# where C# says "double", "str" for text. An unrecognised name is ignored.
INPUTS = [
    ("Geometry", "GeometryBase", "item", "Geometry to copy. Wire a Polygon component here."),
    ("Radius",   "float",        "item", "Radius of the ring, in model units."),
    ("Count",    "int",          "item", "How many copies to place around the ring."),
]
OUTPUTS = [
    ("Points",  "The ring of points, one per copy."),
    ("Arrayed", "The input geometry copied and rotated to each point."),
]

comp = ghenv.Component


def set_identity():
    """Component-level metadata. Description is what the tooltip shows now and is
    regenerated on load; Tooltip is the durable slot archived into the .gh and
    restored over Description on open. Write both."""
    comp.Name = NAME
    comp.NickName = NICK
    comp.Description = BLURB
    comp.Tooltip = BLURB

    # The canvas icon slot is a plain Bitmap. Re-stamped every solve — one this
    # small costs nothing, and there is nowhere on a .NET object to hang a flag.
    bmp = SD.Bitmap(24, 24)
    g = SD.Graphics.FromImage(bmp)
    g.SmoothingMode = SD.Drawing2D.SmoothingMode.AntiAlias
    g.Clear(SD.Color.Transparent)
    g.DrawEllipse(SD.Pen(SD.Color.FromArgb(220, 40, 60, 90), 2.0), 4, 4, 16, 16)
    for k in range(6):
        a = 2 * math.pi * k / 6
        g.FillEllipse(SD.Brushes.MediumSeaGreen, 11 + 8 * math.cos(a), 11 + 8 * math.sin(a), 3, 3)
    g.Dispose()
    comp.SetIconOverride(bmp)
    comp.IconDisplayMode = GH_IconDisplayMode.icon


def set_param_text():
    """Per-param metadata. ToolTip is the durable slot — writing it writes
    Description too. Writing Description alone is replaced by the converter's
    generic text on the next load or source push."""
    access = {"item": GH_ParamAccess.item,
              "list": GH_ParamAccess.list,
              "tree": GH_ParamAccess.tree}
    for name, hint, acc, tip in INPUTS:
        p = next((q for q in comp.Params.Input if q.NickName == name), None)
        if p is None:
            continue
        p.PrettyName = name
        p.ToolTip = tip
        p.TypeHints.Select(hint)     # a Converter on the param, unrelated to the code
        p.Access = access[acc]
    for name, tip in OUTPUTS:
        p = next((q for q in comp.Params.Output if q.NickName == name), None)
        if p is not None:
            p.PrettyName = name
            p.ToolTip = tip          # never hint a Python output: it breaks list results


def shape_is_right():
    have_out = [p.NickName for p in comp.Params.Output if p.NickName != "out"]
    return ([p.NickName for p in comp.Params.Input] == [s[0] for s in INPUTS]
            and have_out == [s[0] for s in OUTPUTS])


def build_params():
    """A script component implements IGH_VariableParameterComponent — that is what
    the zoom-in + / - widgets drive — so it can build its own params. Do it OUTSIDE
    the solution, or GH 8's 'object expired during a solution' guard locks the
    canvas."""
    def fit(side, params, names, offset):
        want = len(names) + offset
        while params.Count > want:
            p = params[params.Count - 1]
            comp.DestroyParameter(side, params.Count - 1)
            comp.Params.UnregisterParameter(p)
        while params.Count < want:
            p = comp.CreateParameter(side, params.Count)
            if side == GH_ParameterSide.Input:
                comp.Params.RegisterInputParam(p)
            else:
                comp.Params.RegisterOutputParam(p)
        for i, n in enumerate(names):
            params[i + offset].VariableName = n   # == NickName == the Python global

    def rebuild(doc):
        fit(GH_ParameterSide.Input, comp.Params.Input, [s[0] for s in INPUTS], 0)
        # The built-in "out" print stream sits at Output[0] when shown; leave it
        # alone and fit only what follows it.
        keep = sum(1 for p in comp.Params.Output if p.NickName == "out")
        fit(GH_ParameterSide.Output, comp.Params.Output, [s[0] for s in OUTPUTS], keep)
        set_param_text()      # hints and tooltips land with the params, not a solve later
        comp.Params.OnParametersChanged()
        comp.ExpireSolution(False)

    comp.OnPingDocument().ScheduleSolution(
        5, Grasshopper.Kernel.GH_Document.GH_ScheduleDelegate(rebuild))


# --- run ----------------------------------------------------------------------
set_identity()
set_param_text()

if not shape_is_right():
    build_params()
    Points, Arrayed = [], []
else:
    # An UNWIRED input is not None on a Python 3 component — the name is never
    # bound at all, and touching it raises NameError. (C# hands RunScript a
    # default-valued argument instead: 0.0 for a double, null for geometry.)
    # So read every input through globals(), never by bare name.
    geometry = globals().get("Geometry")
    radius = globals().get("Radius") or 0.0
    count = int(globals().get("Count") or 0)

    Points, Arrayed = [], []
    for i in range(count):
        t = 2 * math.pi * i / max(count, 1)
        pt = rg.Point3d(radius * math.cos(t), radius * math.sin(t), 0.0)
        Points.append(pt)

        if geometry is None:
            continue
        frame = rg.Plane(pt, rg.Vector3d.ZAxis)
        frame.Rotate(t, rg.Vector3d.ZAxis, pt)
        copy = geometry.Duplicate()
        copy.Transform(rg.Transform.PlaneToPlane(rg.Plane.WorldXY, frame))
        Arrayed.append(copy)
# ---------- end ringarr_2 ----------
# 1. Add a fresh Python 3 Script component.
# 2. Copy the source text from ring-array-stock.py
# 3. Paste text into the component via the Script Editor.
# Input parameters are established, including
# type hints. Output parameters are not set. No
# tooltips, component name, or icon are set.
python_3_script = Python3Script(Geometry=polygon.Polygon, Radius=radius, Count=count)  # -> out, a; inputs Geometry: GeometryBase, Radius: Double, Count: Int32
# ---------- python_3_script: Python ----------
# Ring Array — copies one piece of geometry to a ring of points, rotating each
# copy outward. Wire a Polygon into Geometry for a rosette.
#
# The logic and nothing else: no param tooltips, no component name, no icon.
#
# SDK mode, so the RunScript signature below declares the three INPUTS the same way
# the C# file does — pasting it names them, orders them, and selects the GeometryBase
# / float / int type hints. The annotations are ordinary Python type hints and Rhino's
# guide calls them static-analysis-only; that is true of execution, but the editor
# reads them and they become real converters on the params.
#
# The two OUTPUTS are not declarable in Python at any price. `return Points, Arrayed`
# returns values, not names: the component keeps its stock `a` until you build and
# rename the outputs by hand. That one row is the whole gap against C#.
#
# Unwired, this raises — deliberately. In SDK mode an unbound input arrives as None
# (script mode raises NameError instead), so range(Count) fails until Count is wired.
# C# gets 0 for the same input and quietly does nothing, which is the less honest
# failure of the two.

"""Grasshopper Script"""
import math

import Rhino                      # the annotations below resolve against this
import Grasshopper                # GH_ScriptInstance, the SDK-mode base class
import Rhino.Geometry as rg

class MyComponent(Grasshopper.Kernel.GH_ScriptInstance):
    def RunScript(self,
            Geometry: Rhino.Geometry.GeometryBase,
            Radius: float,
            Count: int):
        Points = []
        Arrayed = []

        for i in range(Count):
            t = 2 * math.pi * i / max(Count, 1)
            pt = rg.Point3d(Radius * math.cos(t), Radius * math.sin(t), 0.0)
            Points.append(pt)

            if Geometry is None:
                continue
            frame = rg.Plane(pt, rg.Vector3d.ZAxis)
            frame.Rotate(t, rg.Vector3d.ZAxis, pt)
            copy = Geometry.Duplicate()
            copy.Transform(rg.Transform.PlaneToPlane(rg.Plane.WorldXY, frame))
            Arrayed.append(copy)
        
        return Points, Arrayed
# ---------- end python_3_script ----------
# Full success like the auto-configured component above that is not linked.
# 
# May show error until inpus are connected.
concatenate_2 = Concatenate(FragmentA=c_script_4.ParentFolderPath, FragmentB=script_file_name_2, JoinSeparator="/")
ringarr_3 = RingArray(script=concatenate_2, Geometry=polygon.Polygon, Radius=radius, Count=count)  # -> out, Points, Arrayed; inputs Geometry: GeometryBase, Radius: Double, Count: Int32; unedited script template
