# Grasshopper definition script-forge-examples.gh (Grasshopper 1.0.8)
# plug-ins: Script Forge

# ----
# 5  ·  Update every instance by name — no lookup rig
# Both panels declare the same header name, 'Mystery Surprise', and Target is the keyword 'name'.
# The forge updates every stock script component on the canvas whose Name matches — here, the one
# on the right. Drag the relay to Mystery Surprise 2 and press again to swap it. 'nickname' matches
# the other way; '+create' forges one if nothing matches, and without it a no-match simply skips.
# Both sources carry their icon as base64 inside the header, so no image file is involved.
mystery_surprise_2 = Panel("""/* @component
{
  "name":        "Mystery Surprise",
  "nickname":    "Mystery",
  "description": "What could it be?",
  "icon":        "base64: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",

  "inputs": [
    { "name": "Count", "nickname": "N", "type": "int", "access": "item",
      "description": "Number of trajectory samples (default 4000)." },
    { "name": "Scale", "nickname": "S", "type": "double", "access": "item",
      "description": "The trajectory is scaled to fit a box this wide (default 10)." },
    { "name": "BasePlane", "nickname": "P", "type": "Plane", "access": "item",
      "description": "Plane the attractor is mapped onto (default world XY)." },
    { "name": "StepSize", "nickname": "dt", "type": "double", "access": "item",
      "description": "Integration time step, smaller is smoother (default 0.01)." }
  ],

  "outputs": [
    { "name": "Points", "nickname": "P", "type": "Point3d", "access": "list",
      "description": "The trajectory sample points, in time order." },
    { "name": "Curves", "nickname": "C", "type": "Curve", "access": "list",
      "description": "A single polyline through the trajectory." }
  ]
}
*/

// Wire-preservation demo trio (with Phyllo Tower CS and Girih Stars CS):
// all three share Count / Scale / BasePlane -> Points / Curves, so re-forging
// one component with a sibling script keeps those wires. Only the unique
// fourth input (here: StepSize) differs.

using System;
using System.Collections.Generic;

using Rhino.Geometry;
using Grasshopper.Kernel;

public class Script_Instance : GH_ScriptInstance
{
  private void RunScript(
      int Count,
      double Scale,
      Plane BasePlane,
      double StepSize,
      out List<Point3d> Points,
      out List<Curve> Curves)
  {
    int n = Count > 0 ? Count : 4000;
    double size = Scale > 0 ? Scale : 10.0;
    Plane plane = BasePlane.IsValid ? BasePlane : Plane.WorldXY;
    double dt = StepSize > 0 ? StepSize : 0.01;

    Vector3d p = new Vector3d(0.1, 0.0, 0.0);
    for (int i = 0; i < 300; i++) // discard the transient run-in
      p = Rk4(p, dt);

    var raw = new List<Vector3d>(n);
    for (int i = 0; i < n; i++)
    {
      p = Rk4(p, dt);
      raw.Add(p);
    }

    // Fit the trajectory into a size-wide box centered on the plane origin.
    Vector3d lo = raw[0], hi = raw[0];
    foreach (Vector3d v in raw)
    {
      lo = new Vector3d(Math.Min(lo.X, v.X), Math.Min(lo.Y, v.Y), Math.Min(lo.Z, v.Z));
      hi = new Vector3d(Math.Max(hi.X, v.X), Math.Max(hi.Y, v.Y), Math.Max(hi.Z, v.Z));
    }
    Vector3d mid = 0.5 * (lo + hi);
    double extent = Math.Max(hi.X - lo.X, Math.Max(hi.Y - lo.Y, hi.Z - lo.Z));
    double f = extent > 0 ? size / extent : 1.0;

    var pts = new List<Point3d>(n);
    foreach (Vector3d v in raw)
      pts.Add(plane.PointAt((v.X - mid.X) * f, (v.Y - mid.Y) * f, (v.Z - mid.Z) * f));

    Points = pts;
    Curves = new List<Curve> { new PolylineCurve(pts) };
  }

  // Aizawa system, classic coefficients.
  private static Vector3d Deriv(Vector3d p)
  {
    const double a = 0.95, b = 0.7, c = 0.6, d = 3.5, e = 0.25, f = 0.1;
    double x = p.X, y = p.Y, z = p.Z;
    return new Vector3d(
        (z - b) * x - d * y,
        d * x + (z - b) * y,
        c + a * z - z * z * z / 3.0 - (x * x + y * y) * (1.0 + e * z) + f * z * x * x * x);
  }

  private static Vector3d Rk4(Vector3d p, double h)
  {
    Vector3d k1 = Deriv(p);
    Vector3d k2 = Deriv(p + 0.5 * h * k1);
    Vector3d k3 = Deriv(p + 0.5 * h * k2);
    Vector3d k4 = Deriv(p + h * k3);
    return p + (h / 6.0) * (k1 + 2.0 * k2 + 2.0 * k3 + k4);
  }
}""")
mystery_surprise_1 = Panel("""/* @component
{
  "name":        "Mystery Surprise",
  "nickname":    "Mystery",
  "description": "What could it be?",
  "icon":        "base64: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",

  "inputs": [
    { "name": "Count", "nickname": "N", "type": "int", "access": "item",
      "description": "Number of seed points (default 300)." },
    { "name": "Scale", "nickname": "S", "type": "double", "access": "item",
      "description": "Base radius of the tower in model units (default 5)." },
    { "name": "BasePlane", "nickname": "P", "type": "Plane", "access": "item",
      "description": "Plane the tower stands on (default world XY)." },
    { "name": "Height", "nickname": "H", "type": "double", "access": "item",
      "description": "Tower height as a multiple of Scale (default 3)." }
  ],

  "outputs": [
    { "name": "Points", "nickname": "P", "type": "Point3d", "access": "list",
      "description": "Seed center points, winding bottom to top." },
    { "name": "Curves", "nickname": "C", "type": "Curve", "access": "list",
      "description": "One outward-facing circle per seed, sized to the local spacing." }
  ]
}
*/

// Wire-preservation demo trio (with Aizawa Attractor CS and Girih Stars CS):
// all three share Count / Scale / BasePlane -> Points / Curves, so re-forging
// one component with a sibling script keeps those wires. Only the unique
// fourth input (here: Height) differs.

using System;
using System.Collections.Generic;

using Rhino.Geometry;
using Grasshopper.Kernel;

public class Script_Instance : GH_ScriptInstance
{
  private void RunScript(
      int Count,
      double Scale,
      Plane BasePlane,
      double Height,
      out List<Point3d> Points,
      out List<Curve> Curves)
  {
    int n = Count > 0 ? Count : 300;
    double radius = Scale > 0 ? Scale : 5.0;
    Plane plane = BasePlane.IsValid ? BasePlane : Plane.WorldXY;
    double height = (Height > 0 ? Height : 3.0) * radius;

    double golden = Math.PI * (3.0 - Math.Sqrt(5.0)); // ~137.5077 degrees
    double scaleR = 0.65 * radius * Math.Sqrt(height / radius / n); // seed circle from per-seed surface area

    var pts = new List<Point3d>();
    var crvs = new List<Curve>();
    for (int i = 0; i < n; i++)
    {
      double t = (i + 0.5) / n;
      double a = i * golden;
      double r = radius * (0.7 + 0.3 * Math.Sin(Math.PI * t)); // vase profile
      double ca = Math.Cos(a);
      double sa = Math.Sin(a);
      Point3d pt = plane.PointAt(r * ca, r * sa, height * t);
      pts.Add(pt);

      Vector3d outward = ca * plane.XAxis + sa * plane.YAxis;
      crvs.Add(new Circle(new Plane(pt, outward), scaleR).ToNurbsCurve());
    }

    Points = pts;
    Curves = crvs;
  }
}""")
target = ValueList({"Create": null, "Name": "name", "Nickname": "nickname", "Match name, create missing": "name+create", "Match nickname, create missing": "nickname+create"}, selected="Name")
run_forge = Button()
script_forge = ScriptForge(
    Source=mystery_surprise_1,
    Target=target,
    Run=run_forge,
    ScriptKitStampedNickName="Forge",
    ScriptKitStampedInputNickName=["Source", "Target", "Run"],
    ScriptKitStampedOutputNickName=["Success", "Log"])  # -> Success, Log
mystery = MysterySurprise()  # -> out, Points, Curves; inputs Count: Int32, Scale: Double, BasePlane: Plane, Height: Double
# ---------- mystery: C# ----------
/* @component
{
  "name":        "Mystery Surprise",
  "nickname":    "Mystery",
  "description": "What could it be?",
  "icon":        "base64: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",

  "inputs": [
    { "name": "Count", "nickname": "N", "type": "int", "access": "item",
      "description": "Number of seed points (default 300)." },
    { "name": "Scale", "nickname": "S", "type": "double", "access": "item",
      "description": "Base radius of the tower in model units (default 5)." },
    { "name": "BasePlane", "nickname": "P", "type": "Plane", "access": "item",
      "description": "Plane the tower stands on (default world XY)." },
    { "name": "Height", "nickname": "H", "type": "double", "access": "item",
      "description": "Tower height as a multiple of Scale (default 3)." }
  ],

  "outputs": [
    { "name": "Points", "nickname": "P", "type": "Point3d", "access": "list",
      "description": "Seed center points, winding bottom to top." },
    { "name": "Curves", "nickname": "C", "type": "Curve", "access": "list",
      "description": "One outward-facing circle per seed, sized to the local spacing." }
  ]
}
*/

// Wire-preservation demo trio (with Aizawa Attractor CS and Girih Stars CS):
// all three share Count / Scale / BasePlane -> Points / Curves, so re-forging
// one component with a sibling script keeps those wires. Only the unique
// fourth input (here: Height) differs.

using System;
using System.Collections.Generic;

using Rhino.Geometry;
using Grasshopper.Kernel;

public class Script_Instance : GH_ScriptInstance
{
  private void RunScript(
		int Count,
		double Scale,
		Plane BasePlane,
		double Height,
		ref object Points,
		ref object Curves)
  {
    int n = Count > 0 ? Count : 300;
    double radius = Scale > 0 ? Scale : 5.0;
    Plane plane = BasePlane.IsValid ? BasePlane : Plane.WorldXY;
    double height = (Height > 0 ? Height : 3.0) * radius;

    double golden = Math.PI * (3.0 - Math.Sqrt(5.0)); // ~137.5077 degrees
    double scaleR = 0.65 * radius * Math.Sqrt(height / radius / n); // seed circle from per-seed surface area

    var pts = new List<Point3d>();
    var crvs = new List<Curve>();
    for (int i = 0; i < n; i++)
    {
      double t = (i + 0.5) / n;
      double a = i * golden;
      double r = radius * (0.7 + 0.3 * Math.Sin(Math.PI * t)); // vase profile
      double ca = Math.Cos(a);
      double sa = Math.Sin(a);
      Point3d pt = plane.PointAt(r * ca, r * sa, height * t);
      pts.Add(pt);

      Vector3d outward = ca * plane.XAxis + sa * plane.YAxis;
      crvs.Add(new Circle(new Plane(pt, outward), scaleR).ToNurbsCurve());
    }

    Points = pts;
    Curves = crvs;
  }
}
# ---------- end mystery ----------

# ----
# Script Forge Examples
# Script Forge creates or updates other Grasshopper script components from C# or Python 3 source.
# Each numbered example below is completely self-contained: its own forge, its own button, its own
# sources and targets. Nothing is wired between them, so you can work through them in any order,
# or delete the ones you don't need.
# 
# Two rules govern the whole component. IDENTITY IS DECLARED, NEVER REMEMBERED: nothing is stored
# in this .gh, and a source finds its component by what its header declares — an instanceGuid, or
# just its name. RUN PUSHES ON THE RISING EDGE AND WATCHES WHILE IT IS HELD: a press forges once,
# and holding Run true only arms the file watchers.
# 
# The .py / .cs files the examples read live in this same folder. Keep them together.
# 1  ·  Forge a component from source text in a panel
# The panel holds an entire .py file — the @component header at the top, then the body.
# Press Run Forge: a live Python 3 component appears beside the forge with its params,
# type hints, access, per-param tooltips and icon already built from that header.
# Press it again as often as you like — the second press finds the component the first
# one made, by the name its own header stamped on it, and updates it in place.
superformula_py = Panel("""\"\"\"@component
{
  "name":        "Superformula PY",
  "nickname":    "Superform",
  "description": "Nested superformula blooms - the Gielis supershape with Lobes petals, repeated in Layers shrinking and slowly rotating copies so the outlines interleave like a pressed flower. Points are the outermost outline samples; Curves are all the nested outlines. Unwired inputs fall back to a 7-lobe bloom of width 10.",
  "icon":        "icons/superformula-py.svg",
  "category":    "Vector",
  "subcategory": "Pattern",

  "inputs": [
    { "name": "Count", "nickname": "N", "type": "int", "access": "item",
      "description": "Samples around each outline (default 720)." },
    { "name": "Scale", "nickname": "S", "type": "double", "access": "item",
      "description": "Overall bloom width in model units (default 10)." },
    { "name": "BasePlane", "nickname": "P", "type": "Plane", "access": "item",
      "description": "Plane the bloom lies on (default world XY)." },
    { "name": "Lobes", "nickname": "m", "type": "int", "access": "item",
      "description": "Petal count of the supershape (default 7)." },
    { "name": "Layers", "nickname": "L", "type": "int", "access": "item",
      "description": "How many nested copies to draw (default 6)." }
  ],

  "outputs": [
    { "name": "Points", "nickname": "P", "type": "Point3d", "access": "list",
      "description": "Sample points of the outermost outline." },
    { "name": "Curves", "nickname": "C", "type": "Curve", "access": "list",
      "description": "The nested outlines, outermost first." }
  ]
}
\"\"\"
# Shares Count / Scale / BasePlane -> Points / Curves with the other pattern
# scripts, so re-forging a component between them keeps those wires.
import math
import Rhino.Geometry as rg

n = int(Count) if Count else 720
size = float(Scale) if Scale else 10.0
plane = BasePlane if BasePlane else rg.Plane.WorldXY
m = int(Lobes) if Lobes else 7
layers = int(Layers) if Layers else 6

n1, n2, n3 = 0.35, 1.7, 1.7

def radius(phi):
    a = abs(math.cos(m * phi / 4.0)) ** n2
    b = abs(math.sin(m * phi / 4.0)) ** n3
    return (a + b) ** (-1.0 / n1) if (a + b) > 1e-12 else 0.0

base = [radius(2.0 * math.pi * k / n) for k in range(n)]
peak = max(base) or 1.0
f = (size * 0.5) / peak

pts = []
crvs = []
for L in range(layers):
    sc = 1.0 - 0.75 * L / layers
    rot = L * math.pi / m  # half a petal per layer, so lobes interleave
    ring = []
    for k in range(n):
        phi = 2.0 * math.pi * k / n
        r = base[k] * f * sc
        ring.append(plane.PointAt(r * math.cos(phi + rot), r * math.sin(phi + rot), 0.0))
    ring.append(ring[0])
    crvs.append(rg.PolylineCurve(ring))
    if L == 0:
        pts = ring[:-1]

Points = pts
Curves = crvs""")
run_forge_2 = Button()
script_forge_2 = ScriptForge(
    Source=superformula_py,
    Run=run_forge_2,
    ScriptKitStampedNickName="Forge",
    ScriptKitStampedInputNickName=["Source", "Target", "Run"],
    ScriptKitStampedOutputNickName=["Success", "Log"])  # -> Success, Log

# ----
# 2  ·  Forge from file paths — resolved next to this .gh
# Source takes a file path just as happily as source text; the
# forge reads the file itself, no Read File component needed. These
# are bare file names, so they resolve against the folder this .gh
# is saved in. Alternatively, an absolute path can be supplied.
# A list of paths expands to one component per path — one press,
# multiple components. Detection is by shape, so path branches and
# text branches can mix freely.
source_paths = Panel("""kumiko-asanoha-py.py
octagon-jali-py.py
forge-demo-cs.cs""")
run_forge_3 = Button()
script_forge_3 = ScriptForge(
    Source=source_paths,
    Run=run_forge_3,
    ScriptKitStampedNickName="Forge",
    ScriptKitStampedInputNickName=["Source", "Target", "Run"],
    ScriptKitStampedOutputNickName=["Success", "Log"])  # -> Success, Log

# ----
# 4  ·  Update one specific component — Target as a guid
# The GUID panel holds the instance guid of the Asanoha component on the right, so the source
# forges into that exact component. Wire Octagon Jali PY to Source instead and press again: script,
# params, tooltips and icon are all swapped in place — and the wires survive, because both sources
# declare the same param names (Count / Scale / BasePlane → Points / Curves). Only a param that is
# genuinely removed loses its connections, and the Log names each one it dropped.
# Octagon Jali PY: """@component
# {
#   "name":        "Octagon Jali PY",
#   "nickname":    "OctJali",
#   "description": "A jali screen on the truncated-square tiling - a grid of octagons whose cut corners form tilted squares at every interior junction, the classic Mughal lattice. Points are the cell centers; Curves are the octagons and corner squares. Unwired inputs fall back to a 5 by 5 panel of width 10.",
#   "icon":        "icons/octagon-jali-py.svg",
#   "category":    "Vector",
#   "subcategory": "Pattern",
# 
#   "inputs": [
#     { "name": "Count", "nickname": "N", "type": "int", "access": "item",
#       "description": "Octagon cells per side of the square panel (default 5)." },
#     { "name": "Scale", "nickname": "S", "type": "double", "access": "item",
#       "description": "Overall panel width in model units (default 10)." },
#     { "name": "BasePlane", "nickname": "P", "type": "Plane", "access": "item",
#       "description": "Plane the panel lies on (default world XY)." },
#     { "name": "Cut", "nickname": "C", "type": "double", "access": "item",
#       "description": "Corner cut as a fraction of the half cell, 0 to 1 (default 0.586 = regular octagons)." }
#   ],
# 
#   "outputs": [
#     { "name": "Points", "nickname": "P", "type": "Point3d", "access": "list",
#       "description": "The center point of every octagon cell." },
#     { "name": "Curves", "nickname": "C", "type": "Curve", "access": "list",
#       "description": "Octagon outlines plus the tilted squares at interior junctions." }
#   ]
# }
# """
# # Shares Count / Scale / BasePlane -> Points / Curves with the other pattern
# # scripts, so re-forging a component between them keeps those wires.
# import Rhino.Geometry as rg
# 
# n = int(Count) if Count else 5
# size = float(Scale) if Scale else 10.0
# plane = BasePlane if BasePlane else rg.Plane.WorldXY
# cut = float(Cut) if Cut else 0.586
# 
# c = size / n
# t = max(0.05, min(0.95, cut)) * c * 0.5
# 
# def closed(pts2d):
#     pts = [plane.PointAt(x, y, 0.0) for x, y in pts2d]
#     pts.append(pts[0])
#     return rg.PolylineCurve(pts)
# 
# pts = []
# crvs = []
# for j in range(n):
#     for i in range(n):
#         cx = -size * 0.5 + (i + 0.5) * c
#         cy = -size * 0.5 + (j + 0.5) * c
#         pts.append(plane.PointAt(cx, cy, 0.0))
#         h = c * 0.5
#         crvs.append(closed([
#             (cx - h + t, cy - h), (cx + h - t, cy - h),
#             (cx + h, cy - h + t), (cx + h, cy + h - t),
#             (cx + h - t, cy + h), (cx - h + t, cy + h),
#             (cx - h, cy + h - t), (cx - h, cy - h + t)]))
# 
# # Tilted square at every interior four-cell junction.
# for j in range(1, n):
#     for i in range(1, n):
#         jx = -size * 0.5 + i * c
#         jy = -size * 0.5 + j * c
#         crvs.append(closed([(jx + t, jy), (jx, jy + t), (jx - t, jy), (jx, jy - t)]))
# 
# Points = pts
# Curves = crvs
kumiko_asanoha_py = Panel("""\"\"\"@component
{
  "name":        "Kumiko Asanoha PY",
  "nickname":    "Asanoha",
  "description": "The kumiko hemp-leaf pattern - a field of equilateral triangles, each latticed with spokes from its centroid to every vertex and edge midpoint, the classic asanoha of Japanese woodwork. Points are the triangle centroids; Curves are the triangle frames and spokes. Unwired inputs fall back to a 6-column panel of width 10.",
  "icon":        "icons/kumiko-asanoha-py.svg",
  "category":    "Vector",
  "subcategory": "Pattern",

  "inputs": [
    { "name": "Count", "nickname": "N", "type": "int", "access": "item",
      "description": "Triangle columns across the panel (default 6)." },
    { "name": "Scale", "nickname": "S", "type": "double", "access": "item",
      "description": "Overall panel width in model units (default 10)." },
    { "name": "BasePlane", "nickname": "P", "type": "Plane", "access": "item",
      "description": "Plane the panel lies on (default world XY)." },
    { "name": "Reach", "nickname": "R", "type": "double", "access": "item",
      "description": "Spoke length as a fraction of centroid-to-edge, 0 to 1 (default 1.0)." }
  ],

  "outputs": [
    { "name": "Points", "nickname": "P", "type": "Point3d", "access": "list",
      "description": "The centroid of every triangle." },
    { "name": "Curves", "nickname": "C", "type": "Curve", "access": "list",
      "description": "Triangle outlines plus six spokes per triangle." }
  ]
}
\"\"\"
# Shares Count / Scale / BasePlane -> Points / Curves with the other pattern
# scripts, so re-forging a component between them keeps those wires.
import math
import Rhino.Geometry as rg

cols = int(Count) if Count else 6
size = float(Scale) if Scale else 10.0
plane = BasePlane if BasePlane else rg.Plane.WorldXY
reach = float(Reach) if Reach is not None else 1.0

a = size / cols
h = a * math.sqrt(3.0) * 0.5
rows = cols
ox = -cols * a * 0.5
oy = -rows * h * 0.5

pts = []
crvs = []

def leaf(v1, v2, v3):
    gx = (v1[0] + v2[0] + v3[0]) / 3.0
    gy = (v1[1] + v2[1] + v3[1]) / 3.0
    g = plane.PointAt(gx, gy, 0.0)
    pts.append(g)
    corners = [plane.PointAt(x, y, 0.0) for x, y in (v1, v2, v3)]
    crvs.append(rg.PolylineCurve(corners + [corners[0]]))
    targets = list((v1, v2, v3))
    for p1, p2 in ((v1, v2), (v2, v3), (v3, v1)):
        targets.append(((p1[0] + p2[0]) * 0.5, (p1[1] + p2[1]) * 0.5))
    for tx, ty in targets:
        tip = plane.PointAt(gx + reach * (tx - gx), gy + reach * (ty - gy), 0.0)
        crvs.append(rg.LineCurve(g, tip))

for j in range(rows):
    y = oy + j * h
    off = 0.5 * a * (j % 2)
    for i in range(cols):
        x0 = ox + i * a + off
        leaf((x0, y), (x0 + a, y), (x0 + a * 0.5, y + h))          # upward
        if i < cols - 1:
            leaf((x0 + a, y), (x0 + a * 0.5, y + h), (x0 + a * 1.5, y + h))  # downward

Points = pts
Curves = crvs""")
guid = Panel("9944a059-3c9d-4d99-8ff5-25c005595f26")
run_forge_4 = Button()
script_forge_4 = ScriptForge(
    Source=kumiko_asanoha_py,
    Target=guid,
    Run=run_forge_4,
    ScriptKitStampedNickName="Forge",
    ScriptKitStampedInputNickName=["Source", "Target", "Run"],
    ScriptKitStampedOutputNickName=["Success", "Log"])  # -> Success, Log
xz_plane = XZPlane(Origin=Point(0, 0, 0))
asanoha = KumikoAsanohaPY(Count=Slider(6, range=1..20), Scale=Slider(10, range=1..100), BasePlane=xz_plane, Reach=Slider(0.612, range=0..1))  # -> out, Points, Curves; inputs Count: Int32, Scale: Double, BasePlane: Plane, Reach: Double
# ---------- asanoha: Python ----------
"""@component
{
  "name":        "Kumiko Asanoha PY",
  "nickname":    "Asanoha",
  "description": "The kumiko hemp-leaf pattern - a field of equilateral triangles, each latticed with spokes from its centroid to every vertex and edge midpoint, the classic asanoha of Japanese woodwork. Points are the triangle centroids; Curves are the triangle frames and spokes. Unwired inputs fall back to a 6-column panel of width 10.",
  "icon":        "icons/kumiko-asanoha-py.svg",
  "category":    "Vector",
  "subcategory": "Pattern",

  "inputs": [
    { "name": "Count", "nickname": "N", "type": "int", "access": "item",
      "description": "Triangle columns across the panel (default 6)." },
    { "name": "Scale", "nickname": "S", "type": "double", "access": "item",
      "description": "Overall panel width in model units (default 10)." },
    { "name": "BasePlane", "nickname": "P", "type": "Plane", "access": "item",
      "description": "Plane the panel lies on (default world XY)." },
    { "name": "Reach", "nickname": "R", "type": "double", "access": "item",
      "description": "Spoke length as a fraction of centroid-to-edge, 0 to 1 (default 1.0)." }
  ],

  "outputs": [
    { "name": "Points", "nickname": "P", "type": "Point3d", "access": "list",
      "description": "The centroid of every triangle." },
    { "name": "Curves", "nickname": "C", "type": "Curve", "access": "list",
      "description": "Triangle outlines plus six spokes per triangle." }
  ]
}
"""
# Shares Count / Scale / BasePlane -> Points / Curves with the other pattern
# scripts, so re-forging a component between them keeps those wires.
import math
import Rhino.Geometry as rg

cols = int(Count) if Count else 6
size = float(Scale) if Scale else 10.0
plane = BasePlane if BasePlane else rg.Plane.WorldXY
reach = float(Reach) if Reach is not None else 1.0

a = size / cols
h = a * math.sqrt(3.0) * 0.5
rows = cols
ox = -cols * a * 0.5
oy = -rows * h * 0.5

pts = []
crvs = []

def leaf(v1, v2, v3):
    gx = (v1[0] + v2[0] + v3[0]) / 3.0
    gy = (v1[1] + v2[1] + v3[1]) / 3.0
    g = plane.PointAt(gx, gy, 0.0)
    pts.append(g)
    corners = [plane.PointAt(x, y, 0.0) for x, y in (v1, v2, v3)]
    crvs.append(rg.PolylineCurve(corners + [corners[0]]))
    targets = list((v1, v2, v3))
    for p1, p2 in ((v1, v2), (v2, v3), (v3, v1)):
        targets.append(((p1[0] + p2[0]) * 0.5, (p1[1] + p2[1]) * 0.5))
    for tx, ty in targets:
        tip = plane.PointAt(gx + reach * (tx - gx), gy + reach * (ty - gy), 0.0)
        crvs.append(rg.LineCurve(g, tip))

for j in range(rows):
    y = oy + j * h
    off = 0.5 * a * (j % 2)
    for i in range(cols):
        x0 = ox + i * a + off
        leaf((x0, y), (x0 + a, y), (x0 + a * 0.5, y + h))          # upward
        if i < cols - 1:
            leaf((x0 + a, y), (x0 + a * 0.5, y + h), (x0 + a * 1.5, y + h))  # downward

Points = pts
Curves = crvs
# ---------- end asanoha ----------
curve = Curve(asanoha.Curves)
point = Point(asanoha.Points)

# ----
# 6  ·  Pin a source to one component  —  "instanceGuid"
# pinned-spiral-py.py names, in its header, the one component it owns. Target is left
# unwired, so the forge walks its identity ladder — header instanceGuid first, then a
# Name match, then create new — and the pin answers on the first rung. Press Run Forge
# over and over and it keeps landing on that same component. A wired Target still wins,
# so a pinned source can be pushed elsewhere deliberately; a Target item that is
# explicitly EMPTY skips the ladder and always makes a second copy. Delete the component
# and press again: it comes back with the same guid (its wires do not).
source_path = Panel("pinned-spiral-py.py")
run_forge_5 = Button()
script_forge_5 = ScriptForge(
    Source=source_path,
    Run=run_forge_5,
    ScriptKitStampedNickName="Forge",
    ScriptKitStampedInputNickName=["Source", "Target", "Run"],
    ScriptKitStampedOutputNickName=["Success", "Log"])  # -> Success, Log
pinned = PinnedSpiralPY(Turns=5, Radius=6)  # -> out, Spiral; inputs Turns: Double, Radius: Double
# ---------- pinned: Python ----------
"""@component
{
  "name":        "Pinned Spiral PY",
  "nickname":    "Pinned",
  "description": "Shows what a header instanceGuid does. This source names the component it owns, so re-forging it with Target unwired updates that same component instead of dropping another copy beside it.",
  "icon":        "icons/spirograph-py.svg",
  "instanceGuid": "33f0a509-752c-4009-91a9-74500215b592",

  "inputs": [
    { "name": "Turns", "type": "double", "access": "item", "default": 5.0,
      "description": "How many revolutions the spiral makes." },
    { "name": "Radius", "type": "double", "access": "item", "default": 6.0,
      "description": "Radius at the outermost turn, in model units." }
  ],

  "outputs": [
    { "name": "Spiral", "type": "Curve", "access": "item",
      "description": "The spiral as an interpolated curve." }
  ]
}
"""
import math
import Rhino.Geometry as rg

turns = float(Turns) if Turns else 5.0
r = float(Radius) if Radius else 6.0
n = int(turns * 64)

pts = []
for k in range(n + 1):
    t = k / float(n)
    a = 2.0 * math.pi * turns * t
    pts.append(rg.Point3d(r * t * math.cos(a), r * t * math.sin(a), 0.0))

Spiral = rg.Curve.CreateInterpolatedCurve(pts, 3)
# ---------- end pinned ----------

# ----
# 8  ·  Two labels per pin  —  "name" and "variableName"
# Hover the pins on the forged component. The pin label IS the variable name: 'variableName' is
# both the text Grasshopper draws and the identifier your code receives. 'name' is the other slot —
# the title of the param's tooltip. Reach for the pair only when one string can't do both jobs:
# 'Max. Radius' is not a legal identifier, and 'Count' is wanted on an input and an output at once,
# which cannot share a variable. Everywhere else, write 'name' alone and both slots collapse to it.
source_path_2 = Panel("labels-demo-cs.cs")
run_forge_6 = Button()
script_forge_6 = ScriptForge(
    Source=source_path_2,
    Run=run_forge_6,
    ScriptKitStampedNickName="Forge",
    ScriptKitStampedInputNickName=["Source", "Target", "Run"],
    ScriptKitStampedOutputNickName=["Success", "Log"])  # -> Success, Log

# ----
# 9  ·  When a forge goes wrong  —  reading Log and Success
# Three sources, one press, three branches. Good Source PY forges cleanly. Broken Header PY has a
# trailing comma, which strict JSON refuses — that branch reports the line and column and stops,
# and the others forge anyway. Broken Body PY has a valid header, so its params and icon are built,
# but the body is misspelled and the component goes red. Note Success still reads TRUE there:
# Success reports the forge's own failures, not a target script's runtime errors. Read the Log.
source_paths_2 = Panel("""good-source-py.py
broken-header-py.py
broken-body-py.py""")
run_forge_7 = Button()
script_forge_7 = ScriptForge(
    Source=source_paths_2,
    Run=run_forge_7,
    ScriptKitStampedNickName="Forge",
    ScriptKitStampedInputNickName=["Source", "Target", "Run"],
    ScriptKitStampedOutputNickName=["Success", "Log"])  # -> Success, Log
good = GoodSourcePY(Radius=4)  # -> out, Circle; inputs Radius: Double
# ---------- good: Python ----------
"""@component
{
  "name":        "Good Source PY",
  "nickname":    "Good",
  "description": "The branch that works. Forged normally: Success reads true and its Log records header parse, param sync, compile and stamping.",
  "icon":        "icons/curve-frames.svg",

  "inputs": [
    { "name": "Radius", "type": "double", "access": "item", "default": 4.0,
      "description": "Radius of the circle, in model units." }
  ],

  "outputs": [
    { "name": "Circle", "type": "Curve", "access": "item",
      "description": "A circle on the world XY plane." }
  ]
}
"""
import Rhino.Geometry as rg

Circle = rg.Circle(rg.Plane.WorldXY, float(Radius) if Radius else 4.0).ToNurbsCurve()
# ---------- end good ----------
broken = BrokenBodyPY(Radius=4)  # -> out, Circle; inputs Radius: Double
# ---------- broken: Python ----------
"""@component
{
  "name":        "Broken Body PY",
  "nickname":    "Broken",
  "description": "The header is valid, so params and metadata are stamped - but the body has a syntax error, so the component itself goes red. Note that Success still reads TRUE: it reports the forge's own failures, not the target script's runtime errors.",
  "icon":        "icons/triangle-prism.svg",

  "inputs": [
    { "name": "Radius", "type": "double", "access": "item", "default": 4.0,
      "description": "Collected fine - the param list is built from the header, which parsed." }
  ],

  "outputs": [
    { "name": "Circle", "type": "Curve", "access": "item",
      "description": "Never produced; the body raises before it is assigned." }
  ]
}
"""
import Rhino.Geometry as rg

# The next line is deliberately wrong - Plane.WorldXY is misspelled.
Circle = rg.Circle(rg.Plane.WorldXZY, float(Radius)).ToNurbsCurve()
# ---------- end broken ----------

# ----
# 7  ·  Inputs that start with a value  —  "default" and "optional"
# Rows, Spacing and Solid all arrive carrying a value with nothing wired to them: the header's
# 'default' becomes the param's persistent data. Solid is the one that matters — a plain unwired
# bool always reads false, so 'defaults to true' is impossible to honour without it. Anchor is
# declared "optional": false, so unwire it and the component goes orange and no code runs at all.
# A value you internalise yourself survives every re-forge; the header can seed a default, not reset one.
source_path_3 = Panel("defaults-demo-cs.cs")
run_forge_8 = Button()
script_forge_8 = ScriptForge(
    Source=source_path_3,
    Run=run_forge_8,
    ScriptKitStampedNickName="Forge",
    ScriptKitStampedInputNickName=["Source", "Target", "Run"],
    ScriptKitStampedOutputNickName=["Success", "Log"])  # -> Success, Log
anchor = Point(Point(0, 0, 0))
defaults = DefaultsDemoCS(Rows=4, Spacing=1.5, Solid=True, Anchor=anchor)  # -> out, Points, Border; inputs Rows: Int32, Spacing: Double, Solid: Boolean, Anchor: Point3d
# ---------- defaults: C# ----------
/* @component
{
  "name":        "Defaults Demo CS",
  "nickname":    "Defaults",
  "description": "Shows the header keys 'default' and 'optional'. Three inputs start out carrying a value even though nothing is wired to them; the fourth refuses to solve until something is.",
  "icon":        "icons/color-blend.svg",

  "inputs": [
    { "name": "Rows", "type": "int", "access": "item", "default": 4,
      "description": "Points per side of the grid. Starts at 4 with nothing wired - the header's 'default' becomes the param's persistent data." },
    { "name": "Spacing", "type": "double", "access": "item", "default": 1.5,
      "description": "Distance between points. Starts at 1.5 with nothing wired." },
    { "name": "Solid", "type": "bool", "access": "item", "default": true,
      "description": "Draw the boundary rectangle. Starts TRUE - which a plain unwired bool can never do, because Grasshopper hands the script false whether you wired false or wired nothing." },
    { "name": "Anchor", "type": "Point3d", "access": "item", "optional": false,
      "description": "Corner the grid is built from. Declared 'optional': false, so leaving it unwired turns the component orange and no code runs at all." }
  ],

  "outputs": [
    { "name": "Points", "type": "Point3d", "access": "list",
      "description": "The grid points, row by row." },
    { "name": "Border", "type": "Curve", "access": "item",
      "description": "The boundary rectangle, or null when Solid is false." }
  ]
}
*/

using System.Collections.Generic;
using Grasshopper.Kernel;
using Rhino.Geometry;

public class Script_Instance : GH_ScriptInstance
{
  private void RunScript(
		int Rows,
		double Spacing,
		bool Solid,
		Point3d Anchor,
		ref object Points,
		ref object Border)
  {
    var pts = new List<Point3d>();
    for (int j = 0; j < Rows; j++)
      for (int i = 0; i < Rows; i++)
        pts.Add(new Point3d(Anchor.X + i * Spacing, Anchor.Y + j * Spacing, Anchor.Z));

    Points = pts;

    double w = (Rows - 1) * Spacing;
    Border = Solid
      ? new Rectangle3d(new Plane(Anchor, Vector3d.ZAxis),
                        new Interval(0, w), new Interval(0, w)).ToNurbsCurve()
      : null;
  }
}
# ---------- end defaults ----------

# ----
# 3  ·  Live editing — the file watcher
# Switching the toggle on does two things: it forges once (Run fires on the rising
# edge), and it arms a watcher on every file-path source. Open watch-me-py.py in any
# editor, change the 'lobes' value near the top, and save — the component on the
# canvas rebuilds a moment later by itself, with no second press. Target is
# 'name+create', so every save updates the same component rather than forging a new
# one. Switch the toggle off to tear the watchers down. It ships off, because an
# armed watcher on document open is a surprise.
target_2 = ValueList({"Create": null, "Name": "name", "Nickname": "nickname", "Match name, create missing": "name+create", "Match nickname, create missing": "nickname+create"}, selected="Match name, create missing")
source_path_4 = Panel("watch-me-py.py")
script_forge_9 = ScriptForge(
    Source=source_path_4,
    Target=target_2,
    Run=Toggle(False),
    ScriptKitStampedNickName="Forge",
    ScriptKitStampedInputNickName=["Source", "Target", "Run"],
    ScriptKitStampedOutputNickName=["Success", "Log"])  # -> Success, Log
watchme = WatchMePY(Count=24, Radius=5)  # -> out, Points, Ring; inputs Count: Int32, Radius: Double
# ---------- watchme: Python ----------
"""@component
{
  "name":        "Watch Me PY",
  "nickname":    "WatchMe",
  "description": "A file-watcher demo. Draws a ring of points on a circle. Edit this file in any editor, save it, and Script Forge re-forges the component on the canvas by itself - no second button press.",
  "icon":        "icons/point-grid-py.svg",

  "inputs": [
    { "name": "Count", "type": "int", "access": "item", "default": 24,
      "description": "How many points to place around the ring." },
    { "name": "Radius", "type": "double", "access": "item", "default": 5.0,
      "description": "Ring radius in model units." }
  ],

  "outputs": [
    { "name": "Points", "type": "Point3d", "access": "list",
      "description": "The ring points, counter-clockwise from the X axis." },
    { "name": "Ring", "type": "Curve", "access": "item",
      "description": "A closed polyline through the points." }
  ]
}
"""
# --- Try this: change the 2.0 below to 3.0 and save the file. ---
# With Run held true, the component on the canvas rebuilds a moment later.
import math
import Rhino.Geometry as rg

n = int(Count) if Count else 24
r = float(Radius) if Radius else 5.0
lobes = 7.0        # <-- edit me, then save

pts = []
for k in range(n):
    a = 2.0 * math.pi * k / n
    rr = r * (1.0 + 0.25 * math.cos(lobes * a))
    pts.append(rg.Point3d(rr * math.cos(a), rr * math.sin(a), 0.0))

Points = pts
Ring = rg.PolylineCurve(pts + [pts[0]])
# ---------- end watchme ----------

# ----
# Scratch rig  —  try your own source
# An empty forge, wired and ready. Paste source text or a file path into the panel, pick a Target
# mode from the drop-down, and press. Nothing else on this canvas depends on it.
target_3 = ValueList({"Create": null, "Name": "name", "Nickname": "nickname", "Match name, create missing": "name+create", "Match nickname, create missing": "nickname+create"}, selected="Create")
source_path_5 = Panel("")
run_forge_9 = Button()
script_forge_10 = ScriptForge(
    Source=source_path_5,
    Target=target_3,
    Run=run_forge_9,
    ScriptKitStampedNickName="Forge",
    ScriptKitStampedInputNickName=["Source", "Target", "Run"],
    ScriptKitStampedOutputNickName=["Success", "Log"])  # -> Success, Log

asanoha_2 = KumikoAsanohaPY()  # -> out, Points, Curves; inputs Count: Int32, Scale: Double, BasePlane: Plane, Reach: Double; same code as asanoha
octjali = OctagonJaliPY()  # -> out, Points, Curves; inputs Count: Int32, Scale: Double, BasePlane: Plane, Cut: Double
# ---------- octjali: Python ----------
"""@component
{
  "name":        "Octagon Jali PY",
  "nickname":    "OctJali",
  "description": "A jali screen on the truncated-square tiling - a grid of octagons whose cut corners form tilted squares at every interior junction, the classic Mughal lattice. Points are the cell centers; Curves are the octagons and corner squares. Unwired inputs fall back to a 5 by 5 panel of width 10.",
  "icon":        "icons/octagon-jali-py.svg",
  "category":    "Vector",
  "subcategory": "Pattern",

  "inputs": [
    { "name": "Count", "nickname": "N", "type": "int", "access": "item",
      "description": "Octagon cells per side of the square panel (default 5)." },
    { "name": "Scale", "nickname": "S", "type": "double", "access": "item",
      "description": "Overall panel width in model units (default 10)." },
    { "name": "BasePlane", "nickname": "P", "type": "Plane", "access": "item",
      "description": "Plane the panel lies on (default world XY)." },
    { "name": "Cut", "nickname": "C", "type": "double", "access": "item",
      "description": "Corner cut as a fraction of the half cell, 0 to 1 (default 0.586 = regular octagons)." }
  ],

  "outputs": [
    { "name": "Points", "nickname": "P", "type": "Point3d", "access": "list",
      "description": "The center point of every octagon cell." },
    { "name": "Curves", "nickname": "C", "type": "Curve", "access": "list",
      "description": "Octagon outlines plus the tilted squares at interior junctions." }
  ]
}
"""
# Shares Count / Scale / BasePlane -> Points / Curves with the other pattern
# scripts, so re-forging a component between them keeps those wires.
import Rhino.Geometry as rg

n = int(Count) if Count else 5
size = float(Scale) if Scale else 10.0
plane = BasePlane if BasePlane else rg.Plane.WorldXY
cut = float(Cut) if Cut else 0.586

c = size / n
t = max(0.05, min(0.95, cut)) * c * 0.5

def closed(pts2d):
    pts = [plane.PointAt(x, y, 0.0) for x, y in pts2d]
    pts.append(pts[0])
    return rg.PolylineCurve(pts)

pts = []
crvs = []
for j in range(n):
    for i in range(n):
        cx = -size * 0.5 + (i + 0.5) * c
        cy = -size * 0.5 + (j + 0.5) * c
        pts.append(plane.PointAt(cx, cy, 0.0))
        h = c * 0.5
        crvs.append(closed([
            (cx - h + t, cy - h), (cx + h - t, cy - h),
            (cx + h, cy - h + t), (cx + h, cy + h - t),
            (cx + h - t, cy + h), (cx - h + t, cy + h),
            (cx - h, cy + h - t), (cx - h, cy - h + t)]))

# Tilted square at every interior four-cell junction.
for j in range(1, n):
    for i in range(1, n):
        jx = -size * 0.5 + i * c
        jy = -size * 0.5 + j * c
        crvs.append(closed([(jx + t, jy), (jx, jy + t), (jx - t, jy), (jx, jy - t)]))

Points = pts
Curves = crvs
# ---------- end octjali ----------
democs = ForgeDemoCS()  # -> out, Mapped, Factor; inputs Value: Double, Source: Interval, Target: Interval, Clamp: Boolean
# ---------- democs: C# ----------
/* @component
{
  "name":        "Forge Demo CS",
  "nickname":    "DemoCS",
  "description": "Tiny C# demo built by Script Forge - remaps a number from a source interval into a target interval.",
  "icon":        "icons/forge-demo-cs.svg",
  "category":    "Maths",
  "subcategory": "Util",

  "inputs": [
    { "name": "Value", "nickname": "V", "type": "double", "access": "item",
      "description": "The number to remap from Source into Target." },
    { "name": "Source", "nickname": "S", "type": "Interval", "access": "item",
      "description": "The interval the value currently lives in." },
    { "name": "Target", "nickname": "T", "type": "Interval", "access": "item",
      "description": "The interval to remap the value into." },
    { "name": "Clamp", "nickname": "C", "type": "bool", "access": "item",
      "description": "When true, the factor is clamped into 0 to 1 before mapping." }
  ],

  "outputs": [
    { "name": "Mapped", "nickname": "M", "type": "double", "access": "item",
      "description": "The remapped number." },
    { "name": "Factor", "nickname": "t", "type": "double", "access": "item",
      "description": "Normalized position (0 to 1) of Value within Source." }
  ]
}
*/

using System;
using System.Collections.Generic;

using Grasshopper.Kernel;
using Rhino.Geometry;

public class Script_Instance : GH_ScriptInstance
{
  private void RunScript(
		double Value,
		Interval Source,
		Interval Target,
		bool Clamp,
		ref object Mapped,
		ref object Factor)
  {
    // Interval members only exist if the type hints applied — this doubles as
    // a hint-verification fixture for Script Forge.
    double t = Source.NormalizedParameterAt(Value);
    if (Clamp) t = Math.Max(0.0, Math.Min(1.0, t));
    Mapped = Target.ParameterAt(t);
    Factor = t;
  }
}
# ---------- end democs ----------
labels = LabelsDemoCS(MaxRadius=8, InCount=12, Radius=3)  # -> out, OutCount, Circles; inputs MaxRadius: Double, InCount: Int32, Radius: Double
# ---------- labels: C# ----------
/* @component
{
  "name":        "Labels Demo CS",
  "nickname":    "Labels",
  "description": "Shows the two label slots on a script param. 'name' is the tooltip title; 'variableName' is the pin label AND the identifier the code receives. Hover each pin to see the pair.",
  "icon":        "icons/branch-sums.svg",

  "inputs": [
    { "name": "Max. Radius", "variableName": "MaxRadius", "type": "double", "access": "item", "default": 8.0,
      "description": "The label wanted here is 'Max. Radius', which is not a legal identifier - so variableName gives the code a usable 'MaxRadius'." },
    { "name": "Count", "variableName": "InCount", "type": "int", "access": "item", "default": 12,
      "description": "An input and an output both want the label 'Count'. They cannot share one variable, so this one is 'InCount' - the tooltip title still reads Count." },
    { "name": "Radius", "type": "double", "access": "item", "default": 3.0,
      "description": "No variableName here, so both slots collapse to 'Radius' - the pin reads Radius and the code takes a Radius argument. This is the usual case." }
  ],

  "outputs": [
    { "name": "Count", "variableName": "OutCount", "type": "int", "access": "item",
      "description": "The same label as the input, on the other side. Its pin reads OutCount and its tooltip is titled Count (OutCount)." },
    { "name": "Circles", "type": "Curve", "access": "list",
      "description": "Concentric circles between Radius and Max. Radius, innermost first." }
  ]
}
*/

using System.Collections.Generic;
using Grasshopper.Kernel;
using Rhino.Geometry;

public class Script_Instance : GH_ScriptInstance
{
  private void RunScript(
		double MaxRadius,
		int InCount,
		double Radius,
		ref object OutCount,
		ref object Circles)
  {
    var crvs = new List<Curve>();
    int n = InCount < 1 ? 1 : InCount;
    for (int i = 0; i < n; i++)
    {
      double t = n == 1 ? 0.0 : i / (double)(n - 1);
      double r = Radius + t * (MaxRadius - Radius);
      crvs.Add(new Circle(Plane.WorldXY, r).ToNurbsCurve());
    }
    Circles = crvs;
    OutCount = crvs.Count;
  }
}
# ---------- end labels ----------
superform = SuperformulaPY()  # -> out, Points, Curves; inputs Count: Int32, Scale: Double, BasePlane: Plane, Lobes: Int32, Layers: Int32
# ---------- superform: Python ----------
"""@component
{
  "name":        "Superformula PY",
  "nickname":    "Superform",
  "description": "Nested superformula blooms - the Gielis supershape with Lobes petals, repeated in Layers shrinking and slowly rotating copies so the outlines interleave like a pressed flower. Points are the outermost outline samples; Curves are all the nested outlines. Unwired inputs fall back to a 7-lobe bloom of width 10.",
  "icon":        "icons/superformula-py.svg",
  "category":    "Vector",
  "subcategory": "Pattern",

  "inputs": [
    { "name": "Count", "nickname": "N", "type": "int", "access": "item",
      "description": "Samples around each outline (default 720)." },
    { "name": "Scale", "nickname": "S", "type": "double", "access": "item",
      "description": "Overall bloom width in model units (default 10)." },
    { "name": "BasePlane", "nickname": "P", "type": "Plane", "access": "item",
      "description": "Plane the bloom lies on (default world XY)." },
    { "name": "Lobes", "nickname": "m", "type": "int", "access": "item",
      "description": "Petal count of the supershape (default 7)." },
    { "name": "Layers", "nickname": "L", "type": "int", "access": "item",
      "description": "How many nested copies to draw (default 6)." }
  ],

  "outputs": [
    { "name": "Points", "nickname": "P", "type": "Point3d", "access": "list",
      "description": "Sample points of the outermost outline." },
    { "name": "Curves", "nickname": "C", "type": "Curve", "access": "list",
      "description": "The nested outlines, outermost first." }
  ]
}
"""
# Shares Count / Scale / BasePlane -> Points / Curves with the other pattern
# scripts, so re-forging a component between them keeps those wires.
import math
import Rhino.Geometry as rg

n = int(Count) if Count else 720
size = float(Scale) if Scale else 10.0
plane = BasePlane if BasePlane else rg.Plane.WorldXY
m = int(Lobes) if Lobes else 7
layers = int(Layers) if Layers else 6

n1, n2, n3 = 0.35, 1.7, 1.7

def radius(phi):
    a = abs(math.cos(m * phi / 4.0)) ** n2
    b = abs(math.sin(m * phi / 4.0)) ** n3
    return (a + b) ** (-1.0 / n1) if (a + b) > 1e-12 else 0.0

base = [radius(2.0 * math.pi * k / n) for k in range(n)]
peak = max(base) or 1.0
f = (size * 0.5) / peak

pts = []
crvs = []
for L in range(layers):
    sc = 1.0 - 0.75 * L / layers
    rot = L * math.pi / m  # half a petal per layer, so lobes interleave
    ring = []
    for k in range(n):
        phi = 2.0 * math.pi * k / n
        r = base[k] * f * sc
        ring.append(plane.PointAt(r * math.cos(phi + rot), r * math.sin(phi + rot), 0.0))
    ring.append(ring[0])
    crvs.append(rg.PolylineCurve(ring))
    if L == 0:
        pts = ring[:-1]

Points = pts
Curves = crvs
# ---------- end superform ----------
